vi "Index.gviweb"   [LabVIEW NXG 5.0.0]
panel controls:
  "Pi (cmH2O)": f64 = 15
  "EDIT MODE": enum{"V A/C", "P A/C", "PSV", "VSIMV", "PSIMV"} = "P A/C"
  "PEEP (cmH2O)": f64 = 5
  "Rate": f64 = 13
  "Start": bool
  "Rise Time": f64 = 2
  "Insp. Time": f64 = 1.5
  "I Sense": f64 = 3
  "Vt Target": f64 = 400
  "SilenceAL": bool
  "PauseAL": bool
  "Freeze Graphs": bool
  "Change Mode": bool
  "URL": string = "http://127.0.0.1:8001/WebService1/"
  "Rate_2": f64 = 13
  "PIP (cmH2O)": f64 = 5
  "PIP (cmH2O)_3": f64 = 5
  "PIP (cmH2O)_4": f64
  "PIP (cmH2O)_6": f64 = 5
  "PIP (cmH2O)_7": f64 = 5
  "PIP (cmH2O)_9": f64 = 5
  "PIP (cmH2O)_10": f64 = 5
  "PIP (cmH2O)_12": f64
  "Alarm_2": bool
  "Waveform": bool
  "Alarm Log": bool
  "Ventilation": bool
  "Ventilation_2": bool
  "Date": string = "27-08-2020"
  "Time": string = "11:50:55"
  "Machine Hour": string
  "Patient Hour": string = "1:30:88"
  "Pressure Settings": enum{"RELATIVE", "ABSOLUTE"} = "RELATIVE"
  "Reset Patient Hour": bool
  "Ventilation_3": bool
  "Maintanance": bool
  "Calibration": bool
  "Apnea Alarm": enum{"YES", "NO"} = "YES"
  "Pediatric Circuite": enum{"YES", "NO"} = "YES"
  "Ventilationb": bool
  "Patient Pressure": cluster{"Slope(M)": f64, "Intercept(c)": f64} = {"Slope(M)"=5, "Intercept(c)"=5}
  "Insp Valve Pressure": cluster{"Slope(M)": f64, "Intercept(c)": f64} = {"Slope(M)"=5, "Intercept(c)"=5}
  "Insp Flow": cluster{"Slope(M)": f64, "Intercept(c)": f64} = {"Slope(M)"=5, "Intercept(c)"=5}
  "Exhalation flow": cluster{"Slope(M)": f64, "Intercept(c)": f64} = {"Slope(M)"=5, "Intercept(c)"=5}
  "Fio2": cluster{"Slope(M)": f64, "Intercept(c)": f64} = {"Slope(M)"=5, "Intercept(c)"=5}
  "Ventilation_5": bool
  "UP": bool
  "Down": bool
  "Max": bool
  "Software Version No": string = "3455X776"
  "Serial No": string = "3465546"
  "Altitude Settinds": enum{"YES", "NO"} = "YES"
  "Ventilation_6": bool
  "Alarm": bool
  "Preference": bool
  "Pi (cmH2O)_2": f64 = 15
  "EDIT MODE_2": enum{"V A/C", "P A/C", "PSV", "VSIMV", "PSIMV"} = "P A/C"
  "PEEP (cmH2O)_2": f64 = 5
  "Rate_5": f64 = 13
  "Start_2": bool
  "Rise Time_2": f64 = 2
  "Insp. Time_2": f64 = 1.5
  "I Sense_2": f64 = 3
  "Vt Target_2": f64 = 400
  "Change Mode_2": bool
  "Rate_6": f64 = 13
  "Alarm_3": bool
  "Waveform_2": bool
  "Preference_2": bool
  "Setup_2": bool
  "PIP (cmH2O)_13": f64 = 5
  "PIP (cmH2O)_14": f64 = 5
  "PIP (cmH2O)_15": f64 = 5
  "PIP (cmH2O)_16": f64
  "PIP (cmH2O)_17": f64 = 5
  "PIP (cmH2O)_18": f64 = 5
  "PIP (cmH2O)_19": f64 = 5
  "PIP (cmH2O)_20": f64
  "PIP (cmH2O)_21": f64 = 5
  "PIP (cmH2O)_22": f64 = 5
  "PIP (cmH2O)_23": f64 = 5
  "PIP (cmH2O)_24": f64
  "Ventilation_7": bool
  "Alarm Log_2": bool
  "PressureChart_2": f64[]
  "FlowChart_2": f64[]
  "VolumeChart_2": f64[]
  "Freeze Graphs_2": bool
  "Ventilation_8": bool
  "Date_2": string = "27-08-2020"
  "Time_2": string = "11:50:55"
  "Machine Hour_2": string
  "Patient Hour_2": string = "1:30:88"
  "Pressure Settings_2": enum{"RELATIVE", "ABSOLUTE"} = "RELATIVE"
  "Reset Patient Hour_2": bool
  "Ventilation_9": bool
  "Maintanance_2": bool
  "Calibration_2": bool
  "Ventilation Report_2": i32 = -1
  "Pediatric Circuite_2": enum{"YES", "NO"} = "YES"
  "Apnea Alarm_2": enum{"YES", "NO"} = "YES"
  "Ventilation_10": bool
  "Patient Pressure_2": cluster{"Slope(M)": f64, "Intercept(c)": f64} = {"Slope(M)"=5, "Intercept(c)"=5}
  "Insp Valve Pressure_2": cluster{"Slope(M)": f64, "Intercept(c)": f64} = {"Slope(M)"=5, "Intercept(c)"=5}
  "Insp Flow_2": cluster{"Slope(M)": f64, "Intercept(c)": f64} = {"Slope(M)"=5, "Intercept(c)"=5}
  "Exhalation flow_2": cluster{"Slope(M)": f64, "Intercept(c)": f64} = {"Slope(M)"=5, "Intercept(c)"=5}
  "Fio2_2": cluster{"Slope(M)": f64, "Intercept(c)": f64} = {"Slope(M)"=5, "Intercept(c)"=5}
  "Ventilation_11": bool
  "Fault Check list_2": i32 = -1
  "Software Version No_2": string = "3455X776"
  "Serial No_2": string = "3465546"
  "Turbine Speed Test_2": string
  "Rate_7": f64 = 13
  "UP_2": bool
  "Down_2": bool
  "Max_2": bool
  "Altitude Settinds_2": enum{"YES", "NO"} = "YES"
  "Rate_8": f64 = 13
  "Ventilation_12": bool
  "Alarm Log List_2": i32 = -1
  "Alarm_4": bool
panel indicators:
  "Tab": i32
  "cmH2O": f64
  "VtI (mL)": f64
  "VtE (mL)": f64
  "M Vol (L)": f64
  "Rate (bpm)": f64
  "I": f64
  "FiO2 (%)": f64
  "E": f64
  "Active Mode": string
  "Pressure": string
  "Last Alarm": string
  "HPA": bool
  "MPA": bool
  "Status": string
  "PressureChart": f64[]
  "FlowChart": f64[]
  "VolumeChart": f64[]
  "value": cluster{"Acknowledged": bool}
  "body": string
  "PIP (cmH2O)_2": f64
  "PIP (cmH2O)_5": f64
  "PIP (cmH2O)_8": f64
  "PIP (cmH2O)_11": f64
  "Ventilation Report": i32
  "Fault Check list": i32
  "Turbine Speed Test": string
  "Rate_4": f64
  "Rate_3": f64
  "Alarm Log List": i32
types:
  T1 = cluster{"M Vol (L)": f64, "VtI (mL)": f64, "Rate (bpm)": f64, "E": f64, "cmH2O": f64, "VtE (mL)": f64, "Pressure": f64[], "Flow": f64[], "Volume": f64[]}
  T2 = cluster{"Rate": f64, "Insp. Time": f64, "Pi (cmH2O)": f64, "PEEP (cmH2O)": f64, "Vt Target": f64}
uses:
  NI::HTTP::GET.gvi
  NI::HTTP::POST Buffer.gvi
  WebApp::Function_2.gvi
diagram:
  Build Array(reference to "Alarm_2", reference to "Waveform", reference to "Preference") -> (outArray=w1, out3=w2)
  Build Array(reference to "Vt Target", reference to "Pi (cmH2O)", reference to "Insp. Time", reference to "Rise Time", reference to "Rate", reference to "I Sense", reference to "PEEP (cmH2O)", reference to "Rate_2") -> w3
  Property Node(instance in=reference to "Tab", "Value"=0) -> (instance out=w4)
  Property Node(instance in=reference to "Start", "Value"=FALSE) -> (error out=w5)
  s1 = w4  # shift register
  while (after w5) (after 0) {
    w6 = $URL
    event (timeout = 200) {
      on "Timeout" {
        disable {
          frame Enabled {
            w8 = default
          }
          frame Disabled {
            Property Node(instance in=cluster{"HMI": u16} {all zero or empty}, "HMI"=$"EDIT MODE") -> (instance out=w9)
            Flatten To Json(anything=w9) -> (JSON string=w10, error out=w8)
          }
        }
        Concatenate Strings(w6, "General") -> w11
        call "GET.gvi"(timeout=100, url=w11, error in=w8) -> (body=w12, error out=w13)
        Unflatten From Json(JSON string=w12, error in (no error)=w13, type and defaults=T1 {all zero or empty}) -> (value=w14)
        Property Node(instance in=w14) -> ("M Vol (L)"=w15, "VtI (mL)"=w16, "Rate (bpm)"=w17, "E"=w18, "cmH2O"=w19, "VtE (mL)"=w20, "Pressure"=w21, "Flow"=w22, "Volume"=w23)
        $"M Vol (L)" <- w15
        $"VtI (mL)" <- w16
        $"Rate (bpm)" <- w17
        $E <- w18
        $cmH2O <- w19
        case ($"Freeze Graphs") {
          frame True { }
          frame False {
            $PressureChart <- w21
            $FlowChart <- w22
            $VolumeChart <- w23
          }
        }
        $"VtE (mL)" <- w20
        w7 = s1
      }
      on "Insp. Time" Value changed; "PEEP (cmH2O)" Value changed; "Pi (cmH2O)" Value changed; "Rate" Value changed; "Vt Target" Value changed {
        Concatenate Strings(w6, "UpdatePara") -> w24
        Property Node(instance in=T2 {all zero or empty}, "Rate"=$Rate, "Insp. Time"=$"Insp. Time", "Pi (cmH2O)"=$"Pi (cmH2O)", "PEEP (cmH2O)"=$"PEEP (cmH2O)", "Vt Target"=$"Vt Target") -> (instance out=w25)
        Flatten To Json(anything=w25) -> (JSON string=w26, error out=w27)
        call "POST Buffer.gvi"(url=w24, buffer=w26, error in=w27, timeout=100) -> (body=w28, error out=w29)
        $body <- w28
        Unflatten From Json(JSON string=w28, error in (no error)=w29, type and defaults=cluster{"Acknowledged": bool} {all zero or empty}) -> (value=w30)
        $value <- w30
        w7 = s1
      }
      on "Alarm_2" Value changed {
        Property Node(instance in=s1, "Value"=1) -> (instance out=w7)
        Property Node(instance in=reference to "Alarm_2")
        call "Function_2.gvi"()
      }
      on "Waveform" Value changed {
        Property Node(instance in=s1, "Value"=2) -> (instance out=w7)
      }
      on "Alarm Log" Value changed {
        Property Node(instance in=s1, "Value"=7) -> (instance out=w7)
      }
      on "Ventilation" Value changed {
        Property Node(instance in=s1, "Value"=0) -> (instance out=w7)
      }
      on "Ventilation_2" Value changed {
        Property Node(instance in=s1, "Value"=0) -> (instance out=w7)
      }
      on "Alarm" Value changed {
        Property Node(instance in=s1, "Value"=1) -> (instance out=w7)
      }
      on "Start" Value changed {
        Event Data() -> ("New Value"=w31)
        case (w31) {
          frame False {
            for {
              w33 = each element of w1
              w34 = each element of [TRUE, TRUE, FALSE, FALSE]
              Property Node(instance in=w33, "Disabled"=w34)
            }
            w32 = "-"
          }
          frame True {
            Property Node(instance in=reference to "EDIT MODE") -> ("Value"=w35)
            Format Into String(w35) -> w32
            for {
              w36 = each element of w1
              w37 = each element of [FALSE, FALSE, TRUE, TRUE]
              Property Node(instance in=w36, "Disabled"=w37)
            }
          }
        }
        $"Active Mode" <- w32
        w7 = s1
      }
      on "Preference" Value changed {
        Property Node(instance in=s1, "Value"=4) -> (instance out=w7)
      }
      on "Calibration" Value changed; "Maintanance" Value changed; "Setup" Value changed; "Ventilation_3" Value changed; "Ventilation_5" Value changed; "Ventilation_6" Value changed; "Ventilationb" Value changed {
        Event Data() -> ("Control Reference"=w38)
        Property Node(instance in=w38) -> ("Text"=w39)
        Array Index(array=w39) -> (out0[0]=w40)
        case (w40) {
          frame "Ventilationa" {
            w41 = 0
          }
          frame "Calibration" {
            w41 = 5
          }
          frame "Maintanance" {
            w41 = 6
          }
          frame "Ventilationb" {
            w41 = 0
          }
          frame "Ventilation_5" {
            w41 = 0
          }
          frame "Ventilation_6" {
            w41 = 0
          }
          frame "Setup", Default {
            w41 = 3
          }
        }
        Property Node(instance in=s1, "Value"=w41) -> (instance out=w7)
      }
      on "EDIT MODE" Value changed {
        Event Data() -> ("New Value"=w42)
        case (w42) {
          frame "V A/C", Default {
            w44 = ["Vt", "PIP", "Insp Time", "Ramp Pattern", "Rate", "I Sense", "NA", "NA"]
            w43 = w44
          }
          frame "P A/C" {
            w45 = ["Pi (cmH2O)", "PEEP", "Rise time", "Insp time", "Rate", "I Sense", "NA", "NA"]
            w43 = w45
          }
          frame "PSV" {
            w46 = ["P support", "PEEP", "Rise time", "Min I time", "Max I time", "I Sense", "E Sense", "Apnea time"]
            w43 = w46
          }
          frame "VSIMV" {
            w47 = ["Vt", "PEEP", "Rise time", "P support", "Rate", "I Sense", "E Sense", "Insp time"]
            w43 = w47
          }
          frame "PSIMV" {
            w48 = ["Pi", "PEEP", "Rise time", "P support", "Rate", "I Sense", "E Sense", "Insp time"]
            w43 = w48
          }
        }
        for {
          w49 = each element of w43
          w50 = each element of w3
          Property Node(instance in=w50) -> ("Label"=w51)
          Property Node(instance in=w51, "Text"=w49)
        }
        w7 = s1
      }
    }
    next s1 = w7
    stop if FALSE
  }
  for {
    w52 = each element of w1
    w53 = each element of [TRUE, TRUE, FALSE, FALSE]
    Property Node(instance in=w52, "Disabled"=w53)
  }
  $Tab <- 0
